# Grasshopper definition auscarboncalc_core.gh (Grasshopper 1.0.8)

mesh = Mesh([<mesh referenced from the Rhino model> x198])
volume = Volume(Geometry=mesh)  # -> Volume, Centroid
ma = MassAddition(Input=volume.Volume)  # -> Result, PartialResults
list = ValueList({"Concrete": "Standard Ready-mix Concrete", "Wood": "Timber / Wood", "Steel": "Structural Steel"}, selected="Steel")
py3 = Python3Script(Material_ID=list, Volume=ma.Result)  # -> R, G, B, a
# ---------- py3: Python ----------
# =====================================================================
# AusCarbonCalc - Core Logic (FINAL & DEBUGGED)
# Lead Systems Architect: Mohsen Javdan Fard
# LCA & Architectural Research: Faezeh Akbari Nikjeh
# =====================================================================

carbon_limit = 15000.0 

# 1. MATERIAL DICTIONARY
MATERIAL_CF_MAP = {
    "Standard Ready-mix Concrete": 320.0,
    "Timber / Wood": -400.0,
    "Structural Steel": 800.0
}

# پردازش متریال ورودی
material_name = "Unknown"
factor = 320.0

if Material_ID is not None:
    material_name = str(Material_ID)
    if material_name in MATERIAL_CF_MAP:
        factor = MATERIAL_CF_MAP[material_name]

# 2. VOLUME HANDLING (مدیریت خطای حجم)
total_volume = 0.0
if Volume is not None:
    try:
        total_volume = float(Volume)
    except TypeError:
        total_volume = 0.0

# محاسبه نهایی کربن
total_carbon = total_volume * factor

# 3. TELEMETRY (منطق هشدار رنگ)
if total_carbon > carbon_limit:
    # NON-COMPLIANT: Red Alert (حالت قرمز)
    R = 255
    G = 50
    G_col = 50
    B = 50
else:
    # COMPLIANT: Green State (حالت سبز)
    R = 50
    G = 255
    G_col = 255
    B = 50

# 4. OUTPUT TEXT (خروجی متنی داینامیک)
a = f"Material: {material_name}\n"
a += f"Total Volume: {round(total_volume, 2)} m3\n"
a += f"Total Carbon:\n{round(total_carbon, 1)} kg CO2-e"
# ---------- end py3 ----------
panel = Panel(py3.a)
rgb = ColourRGB(Alpha=255, Red=py3.R, Green=py3.G, Blue=py3.B)
preview = CustomPreview(Geometry=mesh, Material=rgb)
